# Grasshopper definition 3rob_cell_visualize.ghx (Grasshopper 1.0.7)

# ----
# ROBOT CONNECT
panel = Panel("ros-79hh-s4fg.yaler.io")
ros = ROSConnect(connect=Toggle(True))  # -> ros_client, is_connected; inputs port: Int32, connect: Boolean
#   port ip: The ip address ROS. Defaults to 127.0.0.1.
#   port port: The port of ROS. Defaults to 9090.
#   port connect: If True, connects to ROS. If False, disconnects from ROS. Defaults to False.
#   port ros_client: The ROS client.
#   port is_connected: True if connection established.
# ---------- ros: Python ----------
"""
Connect or disconnect to ROS.

COMPAS FAB v0.19.1
"""
from ghpythonlib.componentbase import executingcomponent as component
from scriptcontext import sticky as st

from compas_fab.backends import RosClient
from compas_fab.ghpython.components import create_id


class ROSConnect(component):
    def RunScript(self, ip, port, connect):
        ros_client = None

        ip = ip or '127.0.0.1'
        port = port or 9090

        key = create_id(self, 'ros_client')
        ros_client = st.get(key, None)

        if ros_client:
            st[key].close()
        if connect:
            st[key] = RosClient(ip, port)
            st[key].run(5)

        ros_client = st.get(key, None)
        is_connected = ros_client.is_connected if ros_client else False
        return (ros_client, is_connected)
# ---------- end ros ----------
data = Data(ros.ros_client)
robot = ROSRobot(ros_client=data, load=Toggle(True))  # -> robot; inputs load: Boolean
#   port ros_client: The ROS client.
#   port load: If True, loads the robot from ROS. Defaults to False.
# ---------- robot: Python ----------
"""
Load robot directly from ROS.

COMPAS FAB v0.19.1
"""
from compas_ghpython.artists import RobotModelArtist
from ghpythonlib.componentbase import executingcomponent as component
from scriptcontext import sticky as st

from compas_fab.ghpython.components import create_id


class ROSRobot(component):
    def RunScript(self, ros_client, load):
        key = create_id(self, 'robot')

        if ros_client and ros_client.is_connected and load:
            # Load URDF from ROS
            st[key] = ros_client.load_robot(load_geometry=True, precision='12f')
            st[key].artist = RobotModelArtist(st[key].model)

        robot = st.get(key, None)
        if robot:  # client sometimes need to be restarted, without needing to reload geometry
            robot.client = ros_client
        return robot
# ---------- end robot ----------
data_2 = Data(robot)

# ----
# ECL PLATFORM MESH
mesh = Mesh([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])

# ----
# Robot 3
j4 = Slider(-284.75, range=-400..400)
j6 = Slider(-20.34, range=-400..400)
j2 = Slider(-7.09, range=-90..150)
j3 = Slider(-2.8, range=-180..75)
j5 = Slider(22.84, range=-125..120)
j1 = Slider(1.16, range=-180..180)
data_3 = Data([j1, j2, j3, j4, j5, j6])

# ----
# Robot 2
j1_2 = Slider(0, range=-180..180)
j2_2 = Slider(0, range=-90..150)
j3_2 = Slider(0, range=-180..75)
j4_2 = Slider(0, range=-400..400)
j5_2 = Slider(0, range=-125..120)
j6_2 = Slider(0, range=-400..400)
track = Slider(1.15, range=0..4)
data_4 = Data([j1_2, j2_2, j3_2, j4_2, j5_2, j6_2, track])

# ----
# Robot 1
j1_3 = Slider(0, range=-180..180)
j2_3 = Slider(0, range=-90..150)
j3_3 = Slider(-9.02, range=-180..75)
j4_3 = Slider(-21.24, range=-400..400)
j5_3 = Slider(7.59, range=-125..120)
j6_3 = Slider(92.01, range=-400..400)
track_2 = Slider(1.82, range=0..4)
data_5 = Data([j1_3, j2_3, j3_3, j4_3, j5_3, j6_3, track_2])

panel_2 = Panel("C:\Users\Edvard\Documents\GitHub\zerowaste_robot\configs\_wobj")
panel_3 = Panel("/Users/edvard/Documents/github/zerowaste_robot/configs/_wobj")
list = ValueList({"x1", "x2", "y1"}, selected="x1")

# ----
# Planning Preset
python = GhPythonScript()  # -> config
# ---------- python: Python ----------
#axis 1-6
config = [
40.55,
16.21,
-13.89,
-0.0,
87.68,
130.55]
# ---------- end python ----------
# PRESET CONFIGS
python_2 = GhPythonScript()  # -> config
# ---------- python_2: Python ----------
#ROBOT 1 CONFIG
#Start path planning from

#axis 1-6 + track (mm)
config = [
-37.57,
-3.24,
8.36,
0.19,
84.45,
230,
100]

#config = [
#-37.57,
#-3.24,
#8.36,
#0.19,
#84.45,
#230,
#100]
# ---------- end python_2 ----------
python_3 = GhPythonScript()  # -> config
# ---------- python_3: Python ----------
#ROBOT 1 CONFIG
#Start path planning from

#axis 1-6 + track
config = [
40.55,
16.21,
-13.89,
-0.0,
87.68,
130.55,
3900]

#axis 1-6 + track
#config = [40.55,16.21,-13.89,-0.0,87.68,130.55,3900]
# ---------- end python_3 ----------
config = GhPythonScript(robot=data_2, r1=python_2, r2=python_3, r3=python)  # -> config, config_scaled; inputs r1: list, r2: list, r3: list
# ---------- config: Python ----------
import math

config = robot.zero_configuration()

for i in range(6):
    config['r1_joint_{}'.format(i + 1)] = r1[i]
    config['r2_joint_{}'.format(i + 1)] = r2[i]
    config['r3_joint_{}'.format(i + 1)] = r3[i]

#mm
config['r1_cart_joint'] = r1[6]
config['r2_cart_joint'] = r2[6]

print config

#for use in path planning
#radians and meters
config_scaled = robot.zero_configuration()

for i in range(6):
    config_scaled['r1_joint_{}'.format(i + 1)] = math.radians(r1[i])
    config_scaled['r2_joint_{}'.format(i + 1)] = math.radians(r2[i])
    config_scaled['r3_joint_{}'.format(i + 1)] = math.radians(r3[i])

#mm --> m
config_scaled['r1_cart_joint'] = r1[6]/1000
config_scaled['r2_cart_joint'] = r2[6]/1000

print config_scaled
# ---------- end config ----------

# ----
# Return Preset
python_4 = GhPythonScript()  # -> config
# ---------- python_4: Python ----------
#RETURN CONFIG (BEFORE PICKUP)

#axis 1-6 + track (mm)
config = [
-90.0,
0.0,
0.0,
0.0,
90,
180,
100]
# ---------- end python_4 ----------
python_5 = GhPythonScript()  # -> config
# ---------- python_5: Python ----------
#RETURN CONFIG (BEFORE PICKUP)

#axis 1-6 + track
config = [
90.0,
0.0,
0.0,
0.0,
90,
180,
3900]
# ---------- end python_5 ----------
python_6 = GhPythonScript()  # -> config
# ---------- python_6: Python ----------
#axis 1-6
config = [
90.0,
0.0,
0.0,
0.0,
90,
180]
# ---------- end python_6 ----------
config_2 = GhPythonScript(robot=data_2, r1=python_4, r2=python_5, r3=python_6)  # -> config, config_scaled; inputs r1: list, r2: list, r3: list; same code as config

r1_tcp_frames = Panel("""x1: [Frame(Point(2.762768, 1.483214, 0.365833), Vector(-0.797, -0.574, -0.189), Vector(-0.506, 0.805, -0.311))]
x2: [Frame(Point(3.104401, 1.481151, 0.366987), Vector(-0.797, -0.574, -0.189), Vector(-0.506, 0.805, -0.311))]
y1: [Frame(Point(3.104434, 1.669760, 0.364630), Vector(-0.797, -0.574, -0.189), Vector(-0.506, 0.805, -0.311))]""")
r2_tcp_frames = Panel("""x1: [Frame(Point(2766.932, 1480.845, 366.978), Vector(1.000, 0.024, -0.017), Vector(0.030, -0.855, 0.518))]
x2: [Frame(Point(3108.758, 1478.910, 367.960), Vector(1.000, 0.024, -0.017), Vector(0.030, -0.855, 0.518))]
y1: [Frame(Point(3108.797, 1667.304, 366.823), Vector(1.000, 0.024, -0.017), Vector(0.030, -0.855, 0.518))]""")
r3_tcp_frames = Panel("""x1: [Frame(Point(2117.427, 237.057, 695.275), Vector(-0.831, 0.545, 0.109), Vector(0.377, 0.697, -0.610))]
x2: [Frame(Point(1775.055, 240.101, 695.195), Vector(-0.831, 0.545, 0.109), Vector(0.377, 0.697, -0.610))]
y1: [Frame(Point(1774.582, 51.813, 691.629), Vector(-0.831, 0.546, 0.109), Vector(0.377, 0.697, -0.610))]""")
list_2 = ValueList({"Robot 1": 1, "Robot 2": 2, "Robot 3": 3}, selected="Robot 3")

# ----
# If axis is included then allow the robot to move along track
rob_num = Number(list_2)
list_3 = ValueList({"Robot 1 - No Track, No Gripper": "robot1_notrack", "Robot 1 - No Track, Gripper": "robot1_notrack_gripper", "Robot 1 - Track, No Gripper": "robot1_track", "Robot 1 - Track, Gripper": "robot1_track_gripper"}, selected="Robot 1 - No Track, No Gripper")
list_4 = ValueList({"Robot 2 - No Track, No Gripper": "robot2_notrack", "Robot 2 - No Track, Gripper": "robot2_notrack_gripper", "Robot 2 - Track, No Gripper": "robot2_track", "Robot 2 - Track, Gripper": "robot2_track_gripper"}, selected="Robot 2 - No Track, No Gripper")
list_5 = ValueList({"Robot 3 - No Gripper": "robot3", "Robot 3 - Gripper": "robot3_gripper"}, selected="Robot 3 - No Gripper")
list_6 = ValueList({"platform": "ecl_platform", "world": "wobj0", "wobj_1": "rob1_acadia_EBIT_01", "wobj_2": "rob2_acadia_EBIT_01"}, selected="world")
list_7 = ValueList({"platform": "ecl_platform", "world": "wobj0", "wobj_1": "rob1_acadia_EBIT_01", "wobj_2": "rob2_acadia_EBIT_01"}, selected="wobj_2")
list_8 = ValueList({"platform": "ecl_platform", "world": "wobj0", "wobj_1": "rob1_acadia_EBIT_01", "wobj_2": "rob2_acadia_EBIT_01"}, selected="wobj_2")
data_6 = Data(list_3)
data_7 = Data(list_4)
panel_4 = Panel(rob_num)
panel_5 = Panel(rob_num)
filter = StreamFilter(Gate=panel_5, Stream1=list_6, Stream2=list_7, Stream3=list_8)
data_8 = Data(filter)

data_9 = Data(list_5)

filter_2 = StreamFilter(Gate=panel_4, Stream1=data_6, Stream2=data_7, Stream3=data_9)
data_10 = Data(filter_2)

# ----
# move/rotate plane around on rhino canvas
pt = Point(<point referenced from the Rhino model>)
crv = Curve(<curve referenced from the Rhino model>)
crv_2 = Curve(<curve referenced from the Rhino model>)
crv_3 = Curve(<curve referenced from the Rhino model>)
crv_4 = Curve(<curve referenced from the Rhino model>)
crv_5 = Curve(<curve referenced from the Rhino model>)
crv_6 = Curve(<curve referenced from the Rhino model>)
pt_2 = Point(<point referenced from the Rhino model>)
pt_3 = Point(<point referenced from the Rhino model>)
pl = ConstructPlane(Origin=pt, XAxis=crv, YAxis=crv_6)
pl_2 = ConstructPlane(Origin=pt_2, XAxis=crv_2, YAxis=crv_3)
pl_3 = ConstructPlane(Origin=pt_3, XAxis=crv_4, YAxis=crv_5)
panel_6 = Panel(rob_num)
filter_3 = StreamFilter(Gate=panel_6, Stream1=pl, Stream2=pl_2, Stream3=pl_3)

# ----
# FORWARD KINEMATICS
config_3 = GhPythonScript(robot=data_2, r1=data_5, r2=data_4, r3=data_3)  # -> config; inputs r1: list, r2: list, r3: list
# ---------- config_3: Python ----------
import math

config = robot.zero_configuration()

for i in range(6):
    config['r1_joint_{}'.format(i + 1)] = math.radians(r1[i])
    config['r2_joint_{}'.format(i + 1)] = math.radians(r2[i])
    config['r3_joint_{}'.format(i + 1)] = math.radians(r3[i])

config['r1_cart_joint'] = r1[6]
config['r2_cart_joint'] = r2[6]

print config
# ---------- end config_3 ----------
gripper_frames = GhPythonScript(robot=data_2, group=data_10, config=config_3)  # -> out
# ---------- gripper_frames: Python ----------
print repr(robot.forward_kinematics(config, group=group))
# ---------- end gripper_frames ----------
panel_7 = Panel(gripper_frames)

# ----
# INVERSE KINEMATICS
use_fk_as_start = BooleanToggle(True)
data_11 = Data(config_3)
filter_4 = StreamFilter(Gate=use_fk_as_start, Stream1=data_11)
pln = Plane(filter_3)
data_12 = Data(filter_4)
ik = InverseKinematics(robot=data_2, plane=pln, start_configuration=data_12, group=data_10)  # -> configuration; disabled
#   port plane: The plane or frame to calculate the inverse kinematic for.
#   port start_configuration: If passed, calculates the inverse such that the joint positions differ the least from the start_configuration. Defaults to the zero configuration.
#   port group: The planning group used for calculation. Defaults to the robot's main planning group.
#   port configuration: The planning group's configuration.
# ---------- ik: Python ----------
"""
Calculate the robot's inverse kinematic for a given plane.

COMPAS FAB v0.19.1
"""
from ghpythonlib.componentbase import executingcomponent as component

from compas_fab.ghpython.components import coerce_frame


class InverseKinematics(component):
    def RunScript(self, robot, plane, start_configuration, group):
        configuration = None
        if robot and robot.client and robot.client.is_connected and plane:
            frame = coerce_frame(plane)
            configuration = robot.inverse_kinematics(frame, start_configuration, group)
        if start_configuration:
            return start_configuration.merged(configuration)
        else:
            return configuration
# ---------- end ik ----------

panel_8 = Panel(rob_num)
python_7 = GhPythonScript()  # -> frame
# ---------- python_7: Python ----------
from compas.geometry import Frame

frame = Frame([0.000473456,0.000169985,0.163856], [1, 0, 0], [0, 1, 0])
# ---------- end python_7 ----------
python_8 = GhPythonScript()  # -> frame
# ---------- python_8: Python ----------
from compas.geometry import Frame

frame = Frame([0.000583723,0.0000236933,0.0779321], [1, 0, 0], [0, 1, 0])
# ---------- end python_8 ----------
python_9 = GhPythonScript()  # -> frame
# ---------- python_9: Python ----------
from compas.geometry import Frame

#calibration tip tcp
frame = Frame([-0.000441033,-0.0000930574,0.164273], [1, 0, 0], [0, 1, 0])
# ---------- end python_9 ----------
filter_5 = StreamFilter(Gate=panel_8, Stream1=python_9, Stream2=python_7, Stream3=python_8)

python_10 = GhPythonScript()  # -> frames_wobj
# ---------- python_10: Python ----------
from compas.geometry import Frame
from compas.geometry import Point
from compas.geometry import Vector

#R1 calibration resulting frames
frames_wobj = {
'x1':Frame(Point(2.762768, 1.483214, 0.365833), Vector(-0.797, -0.574, -0.189), Vector(-0.506, 0.805, -0.311)),
'x2':Frame(Point(3.104401, 1.481151, 0.366987), Vector(-0.797, -0.574, -0.189), Vector(-0.506, 0.805, -0.311)),
'y1':Frame(Point(3.104434, 1.669760, 0.364630), Vector(-0.797, -0.574, -0.189), Vector(-0.506, 0.805, -0.311))
}

frames_wobj = [frames_wobj]
# ---------- end python_10 ----------
python_11 = GhPythonScript()  # -> frames_wobj
# ---------- python_11: Python ----------
from compas.geometry import Frame
from compas.geometry import Point
from compas.geometry import Vector

#R1 calibration resulting frames
frames_wobj = {
'x1':Frame(Point(2.766932, 1.480845, 0.366978), Vector(1.000, 0.024, -0.017), Vector(0.030, -0.855, 0.518)),
'x2':Frame(Point(3.108758, 1.478910, 0.367960), Vector(1.000, 0.024, -0.017), Vector(0.030, -0.855, 0.518)),
'y1':Frame(Point(3.108797, 1.667304, 0.366823), Vector(1.000, 0.024, -0.017), Vector(0.030, -0.855, 0.518))
}

frames_wobj = [frames_wobj]
# ---------- end python_11 ----------
python_12 = GhPythonScript()  # -> frames_wobj
# ---------- python_12: Python ----------
from compas.geometry import Frame
from compas.geometry import Point
from compas.geometry import Vector

#R1 calibration resulting frames
frames_wobj = {
'x1': Frame(Point(2.117427, 0.237057, 0.695275), Vector(-0.831, 0.545, 0.109), Vector(0.377, 0.697, -0.610)),
'x2': Frame(Point(1.775055, 0.240101, 0.695195), Vector(-0.831, 0.545, 0.109), Vector(0.377, 0.697, -0.610)),
'y1': Frame(Point(1.774582, 0.051813, 0.691629), Vector(-0.831, 0.546, 0.109), Vector(0.377, 0.697, -0.610))
}

frames_wobj = [frames_wobj]
# ---------- end python_12 ----------
filter_6 = StreamFilter(Gate=panel_8, Stream1=python_10, Stream2=python_11, Stream3=python_12)

# ----
# READ IN 3 POINT WOBJ CONFIGS
python_13 = GhPythonScript(robot=data_2, path=panel_3, point=list, read_data=Toggle(True))  # -> config, config_scaled
# ---------- python_13: Python ----------
import os
import math
from compas_fab.utilities import read_data_from_json
from compas_fab.robots import Configuration


config = robot.zero_configuration()

if read_data:
    
    for rob_num in range(1,4):
        data = read_data_from_json(os.path.join(path, 'R{}/wobj_{}.json'.format(rob_num,point)))
        #data = read_data_from_json(os.path.join(path, 'R{}\wobj_{}.json'.format(rob_num,point)))
        
        c = Configuration.from_data(data)
        
        if rob_num in [1, 2]:  # only R1 and R2 have an external axis
            config["r{}_cart_joint".format(rob_num)] = c.get("r{}_cart_joint".format(rob_num))
    
        config["r{}_joint_1".format(rob_num)] = c.get("r{}_joint_1".format(rob_num))
        config["r{}_joint_2".format(rob_num)] = c.get("r{}_joint_2".format(rob_num))
        config["r{}_joint_3".format(rob_num)] = c.get("r{}_joint_3".format(rob_num))
        config["r{}_joint_4".format(rob_num)] = c.get("r{}_joint_4".format(rob_num))
        config["r{}_joint_5".format(rob_num)] = c.get("r{}_joint_5".format(rob_num))
        config["r{}_joint_6".format(rob_num)] = c.get("r{}_joint_6".format(rob_num))

print(config)

config_scaled = robot.zero_configuration()

for i in range(6):
    config_scaled['r1_joint_{}'.format(i + 1)] = math.radians(config['r1_joint_{}'.format(i + 1)])
    config_scaled['r2_joint_{}'.format(i + 1)] = math.radians(config['r2_joint_{}'.format(i + 1)])
    config_scaled['r3_joint_{}'.format(i + 1)] = math.radians(config['r3_joint_{}'.format(i + 1)])

#mm --> m
config_scaled['r1_cart_joint'] = config['r1_cart_joint'.format(i + 1)]/1000
config_scaled['r2_cart_joint'] = config['r2_cart_joint'.format(i + 1)]/1000

print(config_scaled)
# ---------- end python_13 ----------
gripper_frames_2 = GhPythonScript(robot=data_2, group=data_10, config=python_13.config_scaled)  # -> out, frame_t0cf
# ---------- gripper_frames_2: Python ----------
print repr(robot.forward_kinematics(config, group=group))

frame_t0cf = robot.forward_kinematics(config, group=group)
# ---------- end gripper_frames_2 ----------
python_14 = GhPythonScript(frame_t0cf=gripper_frames_2.frame_t0cf, tool_frame=filter_5)  # -> out, tool, f1, f2, frame_tcf; inputs frame_t0cf: list
# ---------- python_14: Python ----------
from compas.datastructures import Mesh
from compas.geometry import Frame
from compas_ghpython.artists import FrameArtist

import compas_fab
from compas_fab.robots import Tool

#mesh = Mesh.from_stl(compas_fab.get('planning_scene/cone.stl'))
mesh = Mesh.from_stl('/Users/edvard/Documents/github/ECL_robotic_cell/setup/catkin/abb_irb4600_40_255/meshes/collision/gripper.stl')
tool = Tool(mesh, tool_frame)

frame_tcf = tool.from_t0cf_to_tcf(frame_t0cf)
print frame_t0cf[0]
print frame_tcf[0]
print frame_tcf[0].point.x, frame_tcf[0].point.y, frame_tcf[0].point.z

artist1 = FrameArtist(frame_t0cf[0])
artist2 = FrameArtist(frame_tcf[0])

f1 = artist1.draw()
f2 = artist2.draw()
# ---------- end python_14 ----------
pln_2 = Plane(python_14.f1)
pln_3 = Plane(python_14.f2)

python_15 = GhPythonScript(frame_tcf=python_14.frame_tcf, frames_wobj=filter_6, point=list)  # -> out, a; inputs frame_tcf: list, frames_wobj: list
# ---------- python_15: Python ----------
from compas.geometry import Transformation

frame_tcf = frame_tcf[0]
frame_wobj = frames_wobj[0][point]

print frame_tcf
print frame_wobj

print frame_tcf.point.y - frame_wobj.point.y

diff = Transformation.from_frame_to_frame(frame_tcf,frame_wobj)

print diff
# ---------- end python_15 ----------

list_9 = ValueList({"Forward Kinematics": 0, "Inverse Kinematics": 1, "Preset Start Planning Config": 2, "Preset Return Config": 3, "Preset WOBJ Points": 4}, selected="Preset WOBJ Points")
filter_7 = StreamFilter(
    Gate=list_9,
    Stream0=config_3,
    Stream1=ik,
    Stream2=config.config_scaled,
    Stream3=config_2.config_scaled,
    Stream4=python_13.config_scaled)

panel_9 = Panel(gripper_frames_2.out)
panel_10 = Panel(python_14.out)
robot_visualize = RobotVisualize(
    robot=data_2,
    group=data_10,
    configuration=filter_7,
    show_frames=Toggle(False),
    show_base_frame=Toggle(False),
    show_end_effector_frame=Toggle(True))  # -> visual, collision, attached_meshes, frames, base_frame, ee_frame; inputs attached_collision_meshes: list, show_visual: Boolean, show_collision: Boolean, show_frames: Boolean, show_base_frame: Boolean, show_end_effector_frame: Boolean, show_acm: Boolean
#   port group: The planning group used for end-effector and base visualization.
#   port configuration: The robot's full configuration.
#   port attached_collision_meshes: A list of attached collision meshes.
#   port show_visual: Whether or not to show the robot's visual meshes.
#   port show_collision: Whether or not to show the robot's collision meshes.
#   port show_frames: Whether or not to show the robot's joint frames.
#   port show_base_frame: Whether or not to show the robot's base frame.
#   port show_end_effector_frame: Whether or not to show the robot's end-effector frame.
#   port show_acm: Whether or not to show the attached collision meshes (if any).
#   port visual: The robot's visual Rhino meshes (if any).
#   port collision: The robot's collision Rhino meshes (if any).
#   port attached_meshes: The attached collision Rhino meshes (if any).
#   port frames: The robot's joint frames as Rhino planes (if any).
#   port base_frame: The robot's base frame as a Rhino plane (if any).
#   port ee_frame: The robot's end-effector frame as a Rhino plane (if any).
# ---------- robot_visualize: Python ----------
"""
Visualizes the robot.

COMPAS FAB v0.19.1
"""
from compas.geometry import Frame
from compas.geometry import Transformation
from compas_ghpython.artists import FrameArtist
from compas_ghpython.artists import MeshArtist
from ghpythonlib.componentbase import executingcomponent as component


class RobotVisualize(component):
    def RunScript(self, robot, group, configuration, attached_collision_meshes, show_visual, show_collision,
                  show_frames, show_base_frame, show_end_effector_frame, show_acm):

        visual = None
        collision = None
        attached_meshes = None
        frames = None
        base_frame = None
        ee_frame = None

        if robot:
            show_visual = True if show_visual is None else show_visual
            configuration = configuration or robot.zero_configuration()

            robot.update(configuration, visual=show_visual, collision=show_collision)
            compas_frames = robot.transformed_frames(configuration, group)

            if show_visual:
                visual = robot.artist.draw_visual()

            if show_collision:
                collision = robot.artist.draw_collision()

            if show_base_frame:
                base_compas_frame = compas_frames[0]
                artist = FrameArtist(base_compas_frame)
                base_frame = artist.draw()

            if show_end_effector_frame:
                ee_compas_frame = robot.forward_kinematics(configuration, group, options=dict(solver='model'))
                artist = FrameArtist(ee_compas_frame)
                ee_frame = artist.draw()

            if show_frames:
                frames = []
                for compas_frame in compas_frames[1:]:
                    artist = FrameArtist(compas_frame)
                    frame = artist.draw()
                    frames.append(frame)

            if show_acm:
                attached_meshes = []
                for acm in attached_collision_meshes:
                    frame = robot.forward_kinematics(configuration, options=dict(solver='model', link_name=acm.link_name))
                    T = Transformation.from_frame_to_frame(Frame.worldXY(), frame)
                    mesh = acm.collision_mesh.mesh.transformed(T)
                    attached_meshes.append(MeshArtist(mesh).draw())

        return (visual, collision, attached_meshes, frames, base_frame, ee_frame)
# ---------- end robot_visualize ----------
pln_4 = Plane(robot_visualize.frames)
pln_5 = Plane(robot_visualize.base_frame)
pln_6 = Plane(robot_visualize.ee_frame)
panel_11 = Panel(pln_6)
